# Dynamo graph CLOUD - Topography by Selected Point Cloud Points1.dyn "000 - Topography by Selected Point Cloud Points1" (Dynamo 2.1.0.7500)

code_block = CodeBlock { Flatten([list]); }  # unwired: list
code_block_2 = CodeBlock { Flatten([list]); }  # unwired: list

# group: RESET
# note: You may need to adjust Settings>Geometry Scaling if using large Point Clouds.
# When selecting Points in a 3D View, make sure that the View Cube has a slight rotation (and is not perfectly planar).
boolean = BoolSelector(true)  # graph input

# group: Adjust for units. Groups in purple are pulled from Sastrugi Package. Thanks Ewan!
python_script = Python(IN[0]=boolean)
# ---------- python_script.python (16 lines) ----------
import clr

clr.AddReference('RevitAPI')
from Autodesk.Revit.DB import *

clr.AddReference('RevitServices')
import RevitServices
from RevitServices.Persistence import DocumentManager
from RevitServices.Transactions import TransactionManager

doc = DocumentManager.Instance.CurrentDBDocument

unittype = UnitType.UT_Length
formatoptions = doc.GetUnits().GetFormatOptions(unittype)
dispunits = formatoptions.DisplayUnits
OUT = str(dispunits)
# ----------------------------------------
code_block_3 = CodeBlock()
# ---------- code_block_3.designscript (3 lines) ----------
["Feet",
"Inches"];
true;
# ----------------------------------------
contains = String.Contains(str=python_script, searchFor=code_block_3.out0, ignoreCase=code_block_3.out1)
countTrue = List.CountTrue(list=contains)
code_block_4 = CodeBlock(n=countTrue)
# ---------- code_block_4.designscript (3 lines) ----------
n > 0?
1:
0;
# ----------------------------------------

# group: Extract plane from Active View; select box of Points to use; get line defining box.
boolean_2 = BoolSelector(true)  # graph input
python_script_2 = Python(IN[0]=boolean_2)
# ---------- python_script_2.python (11 lines) ----------
import clr

clr.AddReference("RevitServices")
import RevitServices
from RevitServices.Persistence import DocumentManager
doc = DocumentManager.Instance.CurrentDBDocument
clr.AddReference("RevitNodes")
import Revit
clr.ImportExtensions(Revit.Elements)

OUT = doc.ActiveView.ToDSType(True)
# ----------------------------------------
firstItem = List.FirstItem(list=python_script_2)
python_script_3 = Python(IN[0]=boolean_2, IN[1]=firstItem, IN[2]=code_block_4)
# ---------- python_script_3.python (56 lines) ----------
# Python coding credit to Dynamo Forum user - @Ewan_Opie 2019
# Sastrugi Package https://sites.google.com/view/sastrugi/home

import clr
clr.AddReference('RevitAPI')
import Autodesk
from Autodesk.Revit.DB import *

clr.AddReference("RevitServices")
import RevitServices
from RevitServices.Persistence import DocumentManager

clr.AddReference("RevitAPIUI")
from  Autodesk.Revit.UI import *

clr.AddReference('ProtoGeometry')
from Autodesk.DesignScript.Geometry import *

clr.AddReference('DSCoreNodes') 
import DSCore
from DSCore import *

clr.AddReference("RevitNodes")
import Revit
clr.ImportExtensions(Revit.GeometryConversion)

doc = DocumentManager.Instance.CurrentDBDocument
uidoc=DocumentManager.Instance.CurrentUIApplication.ActiveUIDocument

buttonlist = TaskDialogCommonButtons.Ok
TaskDialog.Show("Sastrugi","Please select a region, bottom left to top right.",buttonlist)

pboxS=Autodesk.Revit.UI.Selection.PickBoxStyle.Enclosing
pickedBox = uidoc.Selection.PickBox(pboxS, "Select a box")
minP = UnwrapElement(pickedBox.Min)
maxP = UnwrapElement(pickedBox.Max)

if IN[2]==0:
	p1=Point.ByCoordinates(minP.X*304.8,minP.Y*304.8,minP.Z*304.8)
	p2=Point.ByCoordinates(maxP.X*304.8,maxP.Y*304.8,maxP.Z*304.8)
else:
	p1=Point.ByCoordinates(minP.X,minP.Y,minP.Z)
	p2=Point.ByCoordinates(maxP.X,maxP.Y,maxP.Z)

aView = UnwrapElement(IN[1])

aVO = aView.Origin.ToPoint()
aVD = aView.ViewDirection.ToVector()
aVP = Plane.ByOriginNormal(aVO,aVD)

rL = Line.ByStartPointEndPoint(p1,p2)
rLaVP = Curve.PullOntoPlane(rL,aVP)

newO = Curve.PointAtParameter(rLaVP,0.5)

OUT = aVP,rLaVP,newO,aView
# ----------------------------------------

# group: Create a box surface from limits of Point Cloud Geometry
code_block_5 = CodeBlock(passthrough=boolean_2, waitfor=python_script_3) { [passthrough,waitfor][0]; }
python_script_4 = Python(IN[0]=code_block_5)
# ---------- python_script_4.python (40 lines) ----------
import clr

clr.AddReference("RevitAPIUI")
from  Autodesk.Revit.UI import *

clr.AddReference("RevitServices")
import RevitServices
from RevitServices.Persistence import DocumentManager
doc = DocumentManager.Instance.CurrentDBDocument
uidoc=DocumentManager.Instance.CurrentUIApplication.ActiveUIDocument

clr.AddReference("RevitNodes")
import Revit
clr.ImportExtensions(Revit.Elements)

def flatten(*args):
    for x in args:
        if hasattr(x, '__iter__'):
            for y in flatten(*x):
                yield y
        else:
            yield x

sel1 = uidoc.Selection
ot1 = Selection.ObjectType.Element
msg = 'Pick PointCloud in Active View.'
TaskDialog.Show("Sastrugi", msg)
el_refs = sel1.PickObject(ot1, "Select")
typelist = list()
idlist = list()
el_ref = flatten(el_refs)
for i in el_ref:

	try:
		typelist.append(doc.GetElement(i.ElementId))
	except:
		typelist.apped(list())
		

OUT = typelist[-1]
# ----------------------------------------
boundingBox = Element.BoundingBox(element=python_script_4)
toCuboid = BoundingBox.ToCuboid(boundingBox=boundingBox)
code_block_6 = CodeBlock(e=toCuboid) { e.Faces; }
vertices = Face.Vertices(face=code_block_6)
pointGeometry = Vertex.PointGeometry(vertex=vertices)
byPerimeterPoints = Surface.ByPerimeterPoints(points=pointGeometry)

code_block_7 = CodeBlock(vwplane=python_script_3, vwdiagline=python_script_3, vwdiaglinemid=python_script_3, out=python_script_3) { vwplane[0]; vwdiagline[1]; vwdiaglinemid[2]; out[3]; }

# group: Determine plane orientation
ZAxis = Vector.ZAxis()
code_block_8 = CodeBlock { 1000; }
translate = Geometry.Translate(geometry=code_block_7.out2, direction=ZAxis, distance=code_block_8)
normal = Plane.Normal(plane=code_block_7.out0)
translate_2 = Geometry.Translate(geometry=code_block_7.out2, direction=normal, distance=code_block_8)
byThreePoints = Plane.ByThreePoints(origin=code_block_7.out2, planePoint=translate, xAxisPoint=translate_2)
YAxis = Plane.YAxis(plane=code_block_7.out0)
byOriginNormal = Plane.ByOriginNormal(origin=code_block_7.out2, normal=YAxis)
code_block_9 = CodeBlock(planecheck=byThreePoints, usethisone=byOriginNormal, usetheotherone=byThreePoints)
# ---------- code_block_9.designscript (3 lines) ----------
planecheck==null?
usethisone:
usetheotherone;
# ----------------------------------------

# group: Create a rectangle using selected box
mirror = Geometry.Mirror(geometry=code_block_7.out1, mirrorPlane=code_block_9)
code_block_10 = CodeBlock { 0..1; }
pointAtParameter = Curve.PointAtParameter(curve=mirror, param=code_block_10)
pointAtParameter_2 = Curve.PointAtParameter(curve=code_block_7.out1, param=code_block_10)
create = List.Create(item0=pointAtParameter, item1=pointAtParameter_2)
transpose = List.Transpose(lists=create)
flatten = List.Flatten(list=transpose)
byCornerPoints = Rectangle.ByCornerPoints(points=flatten)

reverse = Vector.Reverse(vector=normal)
center = Polygon.Center(polygon=byCornerPoints)
project = Point.Project(point=center, baseGeometry=byPerimeterPoints, projectionDirection=reverse, lacing=Longest)
flatten_2 = List.Flatten(list=project)
code_block_11 = CodeBlock { false; }
clean = List.Clean(list=flatten_2, preserveIndices=code_block_11)
distanceTo = Geometry.DistanceTo(geometry=center, other=clean)
maximumItem = List.MaximumItem(list=distanceTo)
code_block_12 = CodeBlock(dist=maximumItem) { dist*2; }
translate_3 = Geometry.Translate(geometry=byCornerPoints, direction=reverse, distance=code_block_12)
points = Polygon.Points(polygon=translate_3)
deconstruct = List.Deconstruct(list=points)
create_2 = List.Create(item0=deconstruct.rest, item1=deconstruct.first)
flatten_3 = List.Flatten(list=create_2)
points_2 = Polygon.Points(polygon=byCornerPoints)
create_3 = List.Create(item0=points, item1=points_2)
transpose_2 = List.Transpose(lists=create_3)
addItemToEnd = List.AddItemToEnd(item=flatten_3@L1, list=transpose_2@L2)
byBestFitThroughPoints = Plane.ByBestFitThroughPoints(points=addItemToEnd)
code_block_13 = CodeBlock(passthrough=python_script_4, waitfor=byBestFitThroughPoints) { [passthrough,waitfor][0]; }
flatten_4 = List.Flatten(list=code_block_13)
firstItem_2 = List.FirstItem(list=flatten_4)
code_block_14 = CodeBlock { 0.001; }

# group: Input: Point sample size
integer_slider = IntegerSlider(10000, range=1000..100000 step 10000)
code_block_15 = CodeBlock(in1=integer_slider)
# ---------- code_block_15.designscript (6 lines) ----------
/*This is the number of points to take
from within the selected region.
Please note that the actual number of
Points output may vary from this
number if a Sectionbox has been used.*/
PointSampleSize: int = in1;
# ----------------------------------------

python_script_5 = Python(IN[0]=firstItem_2, IN[1]=byBestFitThroughPoints, IN[2]=code_block_14, IN[3]=code_block_15)
# ---------- python_script_5.python (46 lines) ----------
import clr
clr.AddReference('ProtoGeometry')
from Autodesk.DesignScript.Geometry import *

clr.AddReference("RevitNodes")
import Revit
clr.ImportExtensions(Revit.Elements)

clr.ImportExtensions(Revit.GeometryConversion)

clr.AddReference("RevitServices")
import RevitServices
from RevitServices.Persistence import DocumentManager
from RevitServices.Transactions import TransactionManager
from System.Collections.Generic import *

clr.AddReference("RevitAPI")
import Autodesk
from Autodesk.Revit.DB import *
from Autodesk.Revit.DB.PointClouds import *


doc = DocumentManager.Instance.CurrentDBDocument
uiapp = DocumentManager.Instance.CurrentUIApplication
app = uiapp.Application
uidoc=DocumentManager.Instance.CurrentUIApplication.ActiveUIDocument

planes=[]
for i in IN[1]:
	planes.append(UnwrapElement(i).ToPlane())
Iplanes=List[Autodesk.Revit.DB.Plane](planes)

pcf=PointCloudFilterFactory.CreateMultiPlaneFilter(planes)

averageDistance = IN[2]
numberOfPoints= IN[3]

points = UnwrapElement(IN[0]).GetPoints(pcf, averageDistance, numberOfPoints)
elements=[]
for p in points:
	X=p.X
	Y=p.Y
	Z=p.Z
	elements.append(Point.Create(XYZ(X,Y,Z)).ToProtoType(True))

OUT = elements
# ----------------------------------------
flatten_5 = List.Flatten(list=python_script_5)

# group: Fix for rotated cloud instance
python_script_6 = Python(IN[0]=flatten_4)
# ---------- python_script_6.python (49 lines) ----------
#BIG THANKS TO @AWILLIAMS

import clr
clr.AddReference('ProtoGeometry')
from Autodesk.DesignScript.Geometry import *

clr.AddReference("RevitNodes")
import Revit
clr.ImportExtensions(Revit.Elements)

clr.AddReference("RevitServices")
import RevitServices
from RevitServices.Persistence import DocumentManager
from RevitServices.Transactions import TransactionManager

from System.Collections.Generic import *

clr.AddReference("RevitAPI")
import Autodesk
from Autodesk.Revit.DB import *

clr.ImportExtensions(Revit.GeometryConversion)

doc = DocumentManager.Instance.CurrentDBDocument
uiapp = DocumentManager.Instance.CurrentUIApplication
app = uiapp.Application


cloud = UnwrapElement(IN[0])

TransactionManager.Instance.EnsureInTransaction(doc)


cloudtransform = []

for c in cloud:
	transform = c.GetTotalTransform()
	X = transform.Origin.X
	Y = transform.Origin.Y
	Z = transform.Origin.Z
	bX = transform.BasisX.ToVector()
	bY = transform.BasisY.ToVector()
	point = Point.Create(XYZ(X,Y,Z)).ToProtoType(True)
	cloudtransform.append(point)
	cloudtransform.append(bX)
		
TransactionManager.Instance.TransactionTaskDone()

OUT = cloudtransform
# ----------------------------------------
code_block_16 = CodeBlock(p=python_script_6) { p[0]; p[1]; }
ZAxis_2 = Vector.ZAxis()
byOriginNormal_2 = Plane.ByOriginNormal(origin=code_block_16.out0, normal=ZAxis_2)
ZAxis_3 = Vector.ZAxis()
XAxis = Vector.XAxis()
angleWithVector = Vector.AngleWithVector(vector=code_block_16.out1, otherVector=XAxis)
rotate = Geometry.Rotate(geometry=byOriginNormal_2, origin=code_block_16.out0, axis=ZAxis_3, degrees=angleWithVector)

# group: Adjust Selected Points by Transform and Section Box Containment (CREDIT TO @Awilliams for Boundingbox code)
code_block_17 = CodeBlock { Flatten([list]); }  # unwired: list
code_block_18 = CodeBlock { Flatten([list]); }  # unwired: list
python_script_7 = Python(IN[0]=boolean_2)  # same code as python_script_2
code_block_19 = CodeBlock { "Section Box"; }
getParameterValueByName = Element.GetParameterValueByName(element=python_script_7, parameterName=code_block_19)
elementType = Element.ElementType(element=code_block_13)
code_block_20 = CodeBlock { "Scale"; }
getParameterValueByName_2 = Element.GetParameterValueByName(element=elementType, parameterName=code_block_20)
scale = Geometry.Scale(geometry=flatten_5, xamount=getParameterValueByName_2, yamount=getParameterValueByName_2, zamount=getParameterValueByName_2)
identity = CoordinateSystem.Identity()
byPlane = CoordinateSystem.ByPlane(plane=rotate)
transform = Geometry.Transform(geometry=scale, fromCoordinateSystem=identity, contextCoordinateSystem=byPlane, lacing=Longest)
code_block_21 = CodeBlock { false; }

flatten_6 = List.Flatten(list=python_script_7)

# group: Section box to cuboid with Rotation
code_block_22 = CodeBlock { Flatten([list]); }  # unwired: list
python_script_8 = Python(IN[0]=flatten_6)
# ---------- python_script_8.python (60 lines) ----------
#BIG THANKS TO @AWILLIAMS

import clr
clr.AddReference('ProtoGeometry')
from Autodesk.DesignScript.Geometry import *

clr.AddReference("RevitNodes")
import Revit
clr.ImportExtensions(Revit.Elements)

clr.AddReference("RevitServices")
import RevitServices
from RevitServices.Persistence import DocumentManager
from RevitServices.Transactions import TransactionManager

from System.Collections.Generic import *

clr.AddReference("RevitAPI")
import Autodesk
from Autodesk.Revit.DB import *

clr.ImportExtensions(Revit.GeometryConversion)

doc = DocumentManager.Instance.CurrentDBDocument
uiapp = DocumentManager.Instance.CurrentUIApplication
app = uiapp.Application


views = UnwrapElement(IN[0])

TransactionManager.Instance.EnsureInTransaction(doc)

sectionboxes = []

for view in views:
	sectionbox = view.GetSectionBox()
	transform = sectionbox.Transform
	sboxoriginx = transform.Origin.X
	sboxoriginy = transform.Origin.Y
	sboxoriginz = transform.Origin.Z
	vx = transform.BasisX.ToVector()
	bp = Point.Create(XYZ(sboxoriginx,sboxoriginy,sboxoriginz)).ToProtoType(True)
	minx = sectionbox.Min.X + sboxoriginx
	maxx = sectionbox.Max.X + sboxoriginx
	miny = sectionbox.Min.Y + sboxoriginy
	maxy = sectionbox.Max.Y + sboxoriginy
	minz = sectionbox.Min.Z + sboxoriginz
	maxz = sectionbox.Max.Z + sboxoriginz
	bbox = BoundingBoxXYZ()
	bbox.Min = XYZ((minx), (miny), (minz))
	bbox.Max = XYZ((maxx), (maxy), (maxz))
	tsectionbox = bbox.ToProtoType()
	sectionboxes.append(tsectionbox)
	sectionboxes.append(vx)
	sectionboxes.append(bp)

	
TransactionManager.Instance.TransactionTaskDone()

OUT = sectionboxes
# ----------------------------------------
code_block_23 = CodeBlock(p=python_script_8) { p[0]; p[1]; p[2]; }
toCuboid_2 = BoundingBox.ToCuboid(boundingBox=code_block_23.out0)
ZAxis_4 = Vector.ZAxis()
YAxis_2 = Vector.YAxis()
angleWithVector_2 = Vector.AngleWithVector(vector=code_block_23.out1, otherVector=YAxis_2)
XAxis_2 = Vector.XAxis()
angleWithVector_3 = Vector.AngleWithVector(vector=code_block_23.out1, otherVector=XAxis_2)
code_block_24 = CodeBlock(v=angleWithVector_2, this1=angleWithVector_3)
# ---------- code_block_24.designscript (3 lines) ----------
v>90?
0-this1:
this1;
# ----------------------------------------
rotate_2 = Geometry.Rotate(geometry=toCuboid_2, origin=code_block_23.out2, axis=ZAxis_4, degrees=code_block_24)

doesIntersect = Geometry.DoesIntersect(geometry=transform, other=rotate_2)

# group (continued): Adjust Selected Points by Transform and Section Box Containment (CREDIT TO @Awilliams for Boundingbox code)
filterByBoolMask = List.FilterByBoolMask(list=transform, mask=doesIntersect)
create_4 = List.Create(item0=filterByBoolMask.in, item1=filterByBoolMask.out)

flatten_7 = List.Flatten(list=create_4)

# group (continued): Adjust Selected Points by Transform and Section Box Containment (CREDIT TO @Awilliams for Boundingbox code)
clean_2 = List.Clean(list=flatten_7, preserveIndices=code_block_21)

isEmpty = List.IsEmpty(list=filterByBoolMask.in)
code_block_25 = CodeBlock(emptyl=isEmpty, opt2=transform)
# ---------- code_block_25.designscript (3 lines) ----------
emptyl==true?
false:
opt2;
# ----------------------------------------

# group (continued): Adjust Selected Points by Transform and Section Box Containment (CREDIT TO @Awilliams for Boundingbox code)
code_block_26 = CodeBlock(section=getParameterValueByName, result1=clean_2, result2=code_block_25)
# ---------- code_block_26.designscript (3 lines) ----------
section==0?
result1:
result2;
# ----------------------------------------

flatten_8 = List.Flatten(list=code_block_26)
code_block_27 = CodeBlock { false; }
pruneDuplicates = Custom[Springs.Points.PruneDuplicates+](points=flatten_8, keepDuplicateZ=code_block_27)  # An alternative to the built in node, that performs faster at the price of loosing the order of the points. All floating point valies are rounded to the nearest 4 decimal points. You can optionally remove duplicate Z values by setting "keepDuplicateZ" to false.
byPoints = Topography.ByPoints(points=pruneDuplicates)
pruneDuplicates_2 = Point.PruneDuplicates()  # unwired: points
code_block_28 = CodeBlock { [passthrough,waitfor][0]; }  # unwired: passthrough, waitfor
code_block_29 = CodeBlock { 0.01; }
